# Requirement set Electram Requirements (R2025b)

## 1 [THE BIG ONE] Part 23 requirements

### 1.1 [Climb Gradients]

#### 1.1.1 [OEI Climb Gradient]

#### 1.1.2 [23.2120: AEO Climb Gradient] 2%
2 percent climb gradient at 400 feet (122 meters) above the takeoff surface with the landing gear retracted and flaps in the approach configuration(s).

#### 1.1.3 [Ceiling Climb Gradient]

#### 1.1.4 [Takeoff Obstacle]

### 1.2 [Weight]

### 1.3 [Wing span]

## 2 [OTHER BIG ONE #2] Performance Requirements

### 2.1 [Cruise Speed]

### 2.2 [Passenger Count] 19 victims

### 2.3 [Range] Greater than 300 nm

### 2.4 [Takeoff]

### 2.5 [Landing]

### 2.6 [Endurance] 99 min bladder time

### 2.7 [Air Stair] Door Stair

### 2.8 [Safety Factor]
Triple redundance in powertrain

#### 2.8.1 [Battery health]
Battery TMS should keep heat down, SOH, battery degradation model stuff

## 3 [PLUS ONE BIG ONE NUMBER #3] RFP

### 3.1 [TO/LD Distance] Less than 4000 ft

### 3.2 [EIS] 2035 (Systems certifiable by 2034)

### 3.3 [Passenger Capacity] Greater than 9

### 3.4 [Wingspan Limit] < 36 m

### 3.5 [Range] > 300 nm

### 3.6 [Propulsion] Multi-engine Configuration

### 3.7 [Airspace Operations] Controlled & uncontrolled airspace compliant. Capable of VFR and IFR flight with an autopilot

### 3.8 [Certification] FAA Part 23

### 3.9 [Reliability] ≥ current equivalent aircraft

### 3.10 [Noise] FAR Part 36 §36.301(c) compliant

### 3.11 [Icing] Capable of flight in known icing conditions

### 3.12 [Maintenance Cost] Lower than current equivalents